# Grasshopper definition rhino stair case.gh (Grasshopper 1.0.7)

curve = Curve(<curve referenced from the Rhino model>)
curve_2 = Curve(<curve referenced from the Rhino model>)

扶手高度_m = Slider(0.9, range=0.5..1.5)

楼梯平台宽_m = Slider(1.8, range=0..5)
踢面高_m = Slider(0.15, range=0.1..0.25)
梯井宽_m = Slider(0.15, range=0.1..0.5)
踏面宽_m = Slider(0.3, range=0.2..0.4)
层高_m = Slider(4.5, range=3..9)
楼板厚度_m = Slider(0.1, range=0.08..0.2)

第一段踏步数 = Slider(14, range=0..30)  # disabled
division = Division(A=踏面宽_m, B=2)
end_points = EndPoints(Curve=curve)  # -> Start, End
end_points_2 = EndPoints(Curve=curve_2)  # -> Start, End
subtraction = Subtraction(A=楼梯平台宽_m, B=踏面宽_m)
division_2 = Division(A=层高_m, B=踢面高_m)
multiplication = Multiplication(A=楼板厚度_m, B=-1)
vector_2pt = Vector2Pt(PointA=end_points.Start, PointB=end_points.End, Unitize=False)  # -> Vector, Length
vector_2pt_2 = Vector2Pt(PointA=end_points.End, PointB=end_points.Start, Unitize=False)  # -> Vector, Length
vector_2pt_3 = Vector2Pt(PointA=end_points_2.Start, PointB=end_points_2.End, Unitize=False)  # -> Vector, Length
unit_z = UnitZ(Factor=multiplication)
踏步总数 = Panel(division_2)
unit_vector = UnitVector(Vector=vector_2pt.Vector)
subtraction_2 = Subtraction(A=vector_2pt.Length, B=梯井宽_m)
unit_vector_2 = UnitVector(Vector=vector_2pt_3.Vector)
division_3 = Division(A=踏步总数, B=2)
subtraction_3 = Subtraction(A=踏步总数, B=division_3)
subtraction_4 = Subtraction(A=subtraction_3, B=1)
subtraction_5 = Subtraction(A=踏步总数, B=第一段踏步数)
subtraction_6 = Subtraction()
amplitude = Amplitude(Vector=unit_vector_2, Amplitude=subtraction)
division_4 = Division(A=subtraction_2, B=2)
amplitude_2 = Amplitude(Vector=unit_vector_2, Amplitude=楼梯平台宽_m)
amplitude_3 = Amplitude(Vector=unit_vector_2, Amplitude=subtraction)
amplitude_4 = Amplitude(Vector=unit_vector_2, Amplitude=踏面宽_m)
unit_z_2 = UnitZ(Factor=踢面高_m)
multiplication_2 = Multiplication(A=subtraction_4, B=踏面宽_m)
multiplication_3 = Multiplication(A=division_3, B=踢面高_m)
unit_z_3 = UnitZ(Factor=multiplication_3)
move = Move(Geometry=end_points.End, Motion=amplitude_4)  # -> Geometry, Transform
move_2 = Move(Geometry=end_points.Start, Motion=amplitude_4)  # -> Geometry, Transform
reverse = Reverse(Vector=unit_z_2)
addition = Addition(A=multiplication_2, B=楼梯平台宽_m)
unit_z_4 = UnitZ(Factor=multiplication_3)
subtraction_7 = Subtraction(A=multiplication_3, B=踢面高_m)
reverse_2 = Reverse(Vector=vector_2pt_2.Vector)
line_sdl = LineSDL(Start=end_points.End, Direction=vector_2pt_2.Vector, Length=division_4)
line_sdl_2 = LineSDL(Start=end_points.Start, Direction=vector_2pt.Vector, Length=division_4)
reverse_3 = Reverse(Vector=vector_2pt.Vector)
unit_vector_3 = UnitVector(Vector=amplitude_4)
amplitude_5 = Amplitude(Vector=reverse_2, Amplitude="0.1")
amplitude_6 = Amplitude(Vector=unit_vector_3, Amplitude=division)
end_points_3 = EndPoints(Curve=line_sdl)  # -> Start, End
end_points_4 = EndPoints(Curve=line_sdl_2)  # -> Start, End
amplitude_7 = Amplitude(Vector=reverse_3, Amplitude="0.1")
move_3 = Move(Geometry=curve, Motion=unit_z_3)  # -> Geometry, Transform
multiplication_4 = Multiplication(A="0.1", B=2)
move_4 = Move(Geometry=move.Geometry, Motion=reverse)  # -> Geometry, Transform
move_5 = Move(Geometry=move_2.Geometry, Motion=unit_z_2)  # -> Geometry, Transform
amplitude_8 = Amplitude(Vector=unit_vector_2, Amplitude=addition)
amplitude_9 = Amplitude(Vector=unit_vector_2, Amplitude=addition)
unit_z_5 = UnitZ(Factor=subtraction_7)
addition_2 = Addition(A=multiplication_4, B=梯井宽_m)
amplitude_10 = Amplitude(Vector=unit_vector, Amplitude=addition_2)
move_6 = Move(Geometry=end_points_3.End, Motion=amplitude_5)  # -> Geometry, Transform
move_7 = Move(Geometry=end_points_4.End, Motion=amplitude_7)  # -> Geometry, Transform
vector_2pt_4 = Vector2Pt(PointA=end_points.Start, PointB=move_5.Geometry, Unitize=False)  # -> Vector, Length
vector_2pt_5 = Vector2Pt(PointA=end_points.End, PointB=move_4.Geometry, Unitize=False)  # -> Vector, Length
move_8 = Move(Geometry=move_3.Geometry, Motion=amplitude_8)  # -> Geometry, Transform
move_9 = Move(Geometry=move_6.Geometry, Motion=amplitude_6)  # -> Geometry, Transform
move_10 = Move(Geometry=move_7.Geometry, Motion=amplitude_6)  # -> Geometry, Transform
unit_z_6 = UnitZ(Factor=1)
move_11 = Move(Geometry=move_8.Geometry, Motion=unit_z_4)  # -> Geometry, Transform
line_sdl_3 = LineSDL(Start=move_9.Geometry, Direction=unit_z_6, Length=扶手高度_m)
line_sdl_4 = LineSDL(Start=move_10.Geometry, Direction=unit_z_6, Length=扶手高度_m)
addition_3 = Addition(A=subtraction_3, B=1)
linear_array = LinearArray(Geometry=line_sdl_3, Direction=vector_2pt_5.Vector, Count=addition_3)  # -> Geometry, Transform
linear_array_2 = LinearArray(Geometry=line_sdl_4, Direction=vector_2pt_4.Vector, Count=addition_3)  # -> Geometry, Transform
extrude = Extrude(Base=[move_3.Geometry, move_11.Geometry], Direction=unit_z)
unit_z_7 = UnitZ(Factor=multiplication_3)
move_12 = Move(Geometry=linear_array.Geometry, Motion=unit_z_7)  # -> Geometry, Transform
move_13 = Move(Geometry=linear_array_2.Geometry, Motion=unit_z_7)  # -> Geometry, Transform
extrude_2 = Extrude(Base=extrude, Direction=amplitude_2)
move_14 = Move(Geometry=move_12.Geometry, Motion=amplitude)  # -> Geometry, Transform
move_15 = Move(Geometry=move_13.Geometry, Motion=amplitude)  # -> Geometry, Transform
list_item = ListItem(List=move_14.Geometry, Index=0, Wrap=True)
reverse_list = ReverseList(List=move_14.Geometry)
pipe = Pipe(Curve=move_14.Geometry, Radius="0.01", Caps=0)
pipe_2 = Pipe(Curve=move_15.Geometry, Radius="0.01", Caps=0)
list_item_2 = ListItem(List=move_15.Geometry, Index=0, Wrap=True)
reverse_list_2 = ReverseList(List=move_15.Geometry)
end_points_5 = EndPoints(Curve=list_item)  # -> Start, End
list_item_3 = ListItem(List=reverse_list, Index=0, Wrap=True)
end_points_6 = EndPoints(Curve=list_item_2)  # -> Start, End
list_item_4 = ListItem(List=reverse_list_2, Index=0, Wrap=True)
end_points_7 = EndPoints(Curve=list_item_3)  # -> Start, End
end_points_8 = EndPoints(Curve=list_item_4)  # -> Start, End
move_16 = Move(Geometry=list_item_4, Motion=amplitude_10)  # -> Geometry, Transform
end_points_9 = EndPoints(Curve=move_16.Geometry)  # -> Start, End
merge = Merge(Data1=end_points_7.End, Data2=end_points_5.End, Data3=end_points_6.End, Data4=end_points_8.End, Data5=end_points_9.End)
polyline = PolyLine(Vertices=merge, Closed=False)
pipe_3 = Pipe(Curve=polyline, Radius="0.025", Caps=0)

linear_array_3 = LinearArray(Geometry=line_sdl, Direction=vector_2pt_5.Vector, Count=division_3)  # -> Geometry, Transform
extrude_3 = Extrude(Base=linear_array_3.Geometry, Direction=amplitude_4)
extrude_4 = Extrude(Base=extrude_3, Direction=unit_z_2)

reverse_list_3 = ReverseList(List=extrude_3)
list_item_5 = ListItem(List=extrude_3, Index=0, Wrap=True)
list_item_6 = ListItem(List=reverse_list_3, Index=0, Wrap=True)
brep_edges = BrepEdges(Brep=list_item_5)  # -> Naked, Interior, NonManifold
brep_edges_2 = BrepEdges(Brep=list_item_6)  # -> Naked, Interior, NonManifold
join_curves = JoinCurves(Curves=brep_edges.Naked, Preserve=False)
join_curves_2 = JoinCurves(Curves=brep_edges_2.Naked, Preserve=False)
loft = Loft(
    Curves=[join_curves, join_curves_2],
    Options={Adjust=False, Closed=False, LoftEnds=0, LoftSimp=0, LoftType=0, Rebuild=10, Refit=0.01})

move_17 = Move(Geometry=[extrude_4, loft], Motion=amplitude_3)  # -> Geometry, Transform
move_18 = Move(Geometry=move_17.Geometry, Motion=unit_z_5)  # -> Geometry, Transform

linear_array_4 = LinearArray(Geometry=line_sdl_2, Direction=vector_2pt_4.Vector, Count=subtraction_3)  # -> Geometry, Transform
extrude_5 = Extrude(Base=linear_array_4.Geometry, Direction=amplitude_4)
extrude_6 = Extrude(Base=extrude_5, Direction=unit_z_2)

reverse_list_4 = ReverseList(List=extrude_5)
list_item_7 = ListItem(List=extrude_5, Index=0, Wrap=True)
list_item_8 = ListItem(List=reverse_list_4, Index=0, Wrap=True)
brep_edges_3 = BrepEdges(Brep=list_item_7)  # -> Naked, Interior, NonManifold
brep_edges_4 = BrepEdges(Brep=list_item_8)  # -> Naked, Interior, NonManifold
join_curves_3 = JoinCurves(Curves=brep_edges_3.Naked, Preserve=False)
join_curves_4 = JoinCurves(Curves=brep_edges_4.Naked, Preserve=False)
loft_2 = Loft(
    Curves=[join_curves_3, join_curves_4],
    Options={Adjust=False, Closed=False, LoftEnds=0, LoftSimp=0, LoftType=0, Rebuild=10, Refit=0.01})

move_19 = Move(Geometry=[extrude_6, loft_2], Motion=amplitude_2)  # -> Geometry, Transform
move_20 = Move(Geometry=move_19.Geometry, Motion=unit_z_4)  # -> Geometry, Transform

merge_2 = Merge(Data1=pipe_3, Data2=pipe, Data3=pipe_2, Data4=extrude_2, Data5=move_20.Geometry, Data6=move_18.Geometry)
