# Grasshopper definition stair case 2.0.gh (Grasshopper 1.0.7)

是否顶层 = BooleanToggle(True)
楼梯间开间 = Slider(3, range=0..10)
梯井宽度 = Slider(0.1, range=0..0.5)
层高 = Slider(4.5, range=2.4..8.4)
踏步高 = Slider(0.15, range=0.1..0.2)
平台宽 = Slider(1.5, range=0.3..3)
踏步宽 = Slider(0.3, range=0.25..0.5)

# ---- group: 计算模块
subtraction = Subtraction(A=楼梯间开间, B=梯井宽度)
division = Division(A=梯井宽度, B=2)
division_2 = Division(A=层高, B=踏步高)
subtraction_2 = Subtraction(A=平台宽, B=踏步宽)
division_3 = Division(A=subtraction, B=2)
division_4 = Division(A=层高, B=2)
division_5 = Division(A=division_2, B=2)
addition = Addition(A=division_3, B=梯井宽度)
addition_2 = Addition(A=division_3, B=division)
multiplication = Multiplication(A=division_5, B=踏步宽)

# ---- group: 搞一根踏步的锯齿线出来
unit_x = UnitX(Factor=1)
unit_x_2 = UnitX(Factor=addition)
point = Point(Point(0, 0, 0))
move = Move(Geometry=point, Motion=unit_x_2)  # -> Geometry, Transform
construct_point = ConstructPoint(XCoordinate=point, YCoordinate=multiplication, ZCoordinate=division_4)
line = Line(StartPoint=point, EndPoint=construct_point)
unit_z = UnitZ(Factor=踏步高)
divide_curve = DivideCurve(Curve=line, Count=division_5, Kinks=False)  # -> Points, Tangents, Parameters
move_2 = Move(Geometry=divide_curve.Points, Motion=unit_z)  # -> Geometry, Transform
panel = Panel("""0
1""")
weave = Weave(Pattern=panel, Stream0=divide_curve.Points, Stream1=move_2.Geometry, NullGaps=False)
list_length = ListLength(List=weave)
subtraction_3 = Subtraction(A=list_length, B=1)
split_list = SplitList(List=weave, Index=subtraction_3)  # -> ListA, ListB
polyline = PolyLine(Vertices=split_list.ListA, Closed=False)

# ---- group: 搞一根踏步的锯齿线出来 / 另一种方法，用box做阵列
line_sdl = LineSDL(Start=point, Direction=unit_x, Length=division_3)  # disabled
line_sdl_2 = LineSDL(Start=move.Geometry, Direction=unit_x, Length=division_3)  # disabled

# ---- group: 平台的线
end_points = EndPoints(Curve=polyline)  # -> Start, End
line_sdl_3 = LineSDL(Start=end_points.End, Direction=Vector(0, 4.571900288, 0), Length=subtraction_2)
line_sdl_4 = LineSDL(Start=end_points.Start, Direction=Vector(0, -4.049628227, 0), Length=平台宽)

# ---- group: 把楼梯底面的剖面线做出来
end_points_2 = EndPoints(Curve=line_sdl_3)  # -> Start, End
move_3 = Move(Geometry=flatten([line, line_sdl_3]), Motion=Vector(0, 0, -0.1))  # -> Geometry, Transform
end_points_3 = EndPoints(Curve=line_sdl_4)  # -> Start, End
join_curves = JoinCurves(Curves=move_3.Geometry, Preserve=False)
line_sdl_5 = LineSDL(Start=end_points_3.End, Direction=Vector(0, 0, -12.7315243), Length="0.1")
end_points_4 = EndPoints(Curve=join_curves)  # -> Start, End
end_points_5 = EndPoints(Curve=join_curves)  # -> Start, End
end_points_6 = EndPoints(Curve=line_sdl_5)  # -> Start, End
line_2 = Line(StartPoint=end_points_2.End, EndPoint=end_points_4.End)
line_3 = Line(StartPoint=end_points_6.End, EndPoint=end_points_5.Start)

# ---- group: 求一下旋转的中心点
join_curves_2 = JoinCurves(Curves=flatten([line_sdl_3, line_sdl_4, polyline]), Preserve=False)
divide_curve_2 = DivideCurve(Curve=join_curves_2, Count="2", Kinks=False)  # -> Points, Tangents, Parameters
list_item = ListItem(List=divide_curve_2.Points, Index=1, Wrap=True)

# ----
unit_y = UnitY(Factor=expr("x *  (-1)", 踏步宽))

# ---- group: 整个梯段和平台搞一个整体brep
join_curves_3 = JoinCurves(Curves=flatten([join_curves, line_sdl_5, line_sdl_3, line_2, polyline, line_sdl_4, line_3]), Preserve=False)
unit_x_3 = UnitX(Factor=division_3)
boundary_surfaces = BoundarySurfaces(Edges=join_curves_3)
move_4 = Move(Geometry=boundary_surfaces, Motion=unit_x_3)  # -> Geometry, Transform
extrude = Extrude(Base=join_curves_3, Direction=unit_x_3)
brep_join = BrepJoin(Breps=[extrude, move_4.Geometry, boundary_surfaces])  # -> Breps, Closed

# ---- group: 补全平台空缺
unit_x_4 = UnitX(Factor=division_3)
move_5 = Move(Geometry=line_sdl_3, Motion=unit_x_4)  # -> Geometry, Transform
unit_x_5 = UnitX(Factor=梯井宽度)
move_6 = Move(Geometry=move_5.Geometry, Motion=unit_x_5)  # -> Geometry, Transform
end_points_7 = EndPoints(Curve=move_5.Geometry)  # -> Start, End
unit_z_2 = UnitZ(Factor=-0.1)
move_7 = Move(Geometry=move_6.Geometry, Motion=unit_z_2)  # -> Geometry, Transform
end_points_8 = EndPoints(Curve=move_7.Geometry)  # -> Start, End
move_8 = Move(Geometry=end_points_8.End, Motion=unit_x_4)  # -> Geometry, Transform

# ----
move_9 = Move(Geometry=end_points_7.Start, Motion=unit_y)  # -> Geometry, Transform

# ---- group: 补全平台空缺 (continued)
box_2pt = Box2Pt(PointA=move_9.Geometry, PointB=end_points_8.End, Plane=PlaneXY(0, 0, 0))
box_2pt_2 = Box2Pt(PointA=move_9.Geometry, PointB=move_8.Geometry, Plane=PlaneXY(0, 0, 0))
stream_filter = StreamFilter(Gate=是否顶层, Stream0=box_2pt, Stream1=box_2pt_2)

# ---- group: 把做好的一边的梯段旋转抬升
unit_x_6 = UnitX(Factor=addition_2)
move_10 = Move(Geometry=list_item, Motion=unit_x_6)  # -> Geometry, Transform
xy_plane = XYPlane(Origin=move_10.Geometry)
rotate = Rotate(Geometry=[brep_join.Breps, stream_filter], Angle=3.141592654, Plane=xy_plane)  # -> Geometry, Transform
unit_z_3 = UnitZ(Factor=division_4)
move_11 = Move(Geometry=rotate.Geometry, Motion=unit_z_3)  # -> flatten(Geometry), Transform

# ----
group = Group(Objects=flatten([move_11.Geometry, brep_join.Breps, box_2pt]))
